# Grasshopper definition Benchmark_Cocoon_Millipede_Dodo.gh (Grasshopper 0.9.76)
# plug-ins: MarchingCubes, Chromodoris, Kangaroo Components, Dodo, Millipede

# ___  _  _  ____   __   _  _   __  ____   __  ____  __  ____
#  / __)/ )( \(  _ \ /  \ ( \/ ) /  \(    \ /  \(  _ \(  )/ ___)
# ( (__ ) __ ( )   /(  O )/ \/ \(  O )) D ((  O ))   / )( \___ \
#  \___)\_)(_/(__\_) \__/ \_)(_/ \__/(____/ \__/(__\_)(__)(____/
# 
# Version 0.0.9.0 Benchmark.
# 
# Copyright Cameron Newnham 2015-2016
box = Box({Plane=Plane(origin=(0, 0, 0), x=(0, 1, 0), y=(1, 0, 0)), X=Domain(0, 100), Y=Domain(0, 100), Z=Domain(-100, 0)})
pop3d = Populate3D(Region=box, Count=100, Seed=1)
prox = Proximity3D(Points=pop3d, Group=5)  # -> Links, Topology
dupln = RemoveDuplicateLines(Lines=flatten(prox.Links), Tolerance=0.01)
number_slider = Slider(1, range=0..1)
number_slider_2 = Slider(5, range=0..10)
number_slider_3 = Slider(2, range=0..10)
line = Line(dupln)
number_slider_4 = Slider(3, range=0..10)
divlength = DivideLength(Curve=line, Length=Slider(2, range=0..10))  # -> flatten(Points), Tangents, Parameters
pcharge = PointCharge(Point=divlength.Points, Charge=1, Decay=2)
voxelsample = SampleVoxels(
    Points=divlength.Points,
    Charges=number_slider,
    VoxelSize=number_slider_4,
    EffectiveRange=number_slider_2,
    DensitySampling=True,
    LinearSampling=True)  # -> Box, VoxelData
point_charge = PointCharge(Point=divlength.Points, Radius=number_slider_2, ChargeStrength=number_slider)
mergef = MergeFields(Fields=pcharge)
gridsize = CSharpScript(x=voxelsample.VoxelData)  # -> out, A, B, C
# ---------- gridsize: C# ----------
    var z = (float[,,]) x;
    A = z.GetLength(0);
    B = z.GetLength(1);
    C = z.GetLength(2);
# ---------- end gridsize ----------
isosurface = BuildIsoSurface(Box=voxelsample.Box, VoxelData=voxelsample.VoxelData, SampleValue=number_slider_3)
cocoon = Cocoon(Charges=point_charge, Iso=number_slider_3, CellSize=number_slider_4, Execute=Toggle(True), Simple=False)  # -> Mesh, RefinementData
voxels = Voxels(Box=voxelsample.Box, Number=gridsize.A, F=mergef)
geometry_wrapper = GeometryWrapper(
    Geometry=divlength.Points,
    Power=10,
    Spread=1,
    Exponent=2,
    Box=voxelsample.Box,
    XResolution=gridsize.A,
    YResolution=gridsize.B,
    ZResolution=gridsize.C)
isomesh = IsoMesh(Voxels=voxels, Isolevel=Slider(0.938, range=0..10), TetrahedraCubes=False)
iso_surface = IsoSurface(
    Box=voxelsample.Box,
    Values=geometry_wrapper,
    XResolution=gridsize.A,
    YResolution=gridsize.B,
    ZResolution=gridsize.C,
    IsoValue=Slider(0.0001, range=0.0001..0.001),
    MergeVertices=False)
mesh = Mesh(cocoon.Mesh)
mesh_2 = Mesh(isosurface)
mesh_3 = Mesh(iso_surface)
mesh_4 = Mesh(isomesh)

# ---- group: Execution Time (s)
cocoon_2 = Panel("2.8")
chromodoris = Panel("0.2")
millipede = Panel("10.1")
dodo = Panel("9.0")
