# Grasshopper definition Benchmark_Smoothing.gh (Grasshopper 0.9.76)
# plug-ins: Chromodoris, Weaverbird

# ___  _  _  ____   __   _  _   __  ____   __  ____  __  ____
#  / __)/ )( \(  _ \ /  \ ( \/ ) /  \(    \ /  \(  _ \(  )/ ___)
# ( (__ ) __ ( )   /(  O )/ \/ \(  O )) D ((  O ))   / )( \___ \
#  \___)\_)(_/(__\_) \__/ \_)(_/ \__/(____/ \__/(__\_)(__)(____/
# 
# Version 0.0.9.0 Benchmark.
# 
# Copyright Cameron Newnham 2015-2016
mesh = Mesh(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)
number_slider = Slider(10, range=0..10)
smooth = QuickSmooth(Mesh=mesh, Step=0.75, Iterations=1)
wblaplace = WeaverbirdsLaplacianSmoothing(MeshCurves=mesh, Level=1, SmoothNakedEdges=1, Thin=1)
wbloop = WeaverbirdsLoopSubdivision(MeshCurves=smooth, Level=1, SmoothNakedEdges=1)
smooth_2 = QuickSmooth(Mesh=wbloop, Step=0.75, Iterations=number_slider)
wblaplace_2 = WeaverbirdsLaplacianSmoothing(MeshCurves=wbloop, Level=number_slider, SmoothNakedEdges=1, Thin=1)
