# Grasshopper definition Examples_01.gh (Grasshopper 0.9.76)
# plug-ins: Chromodoris

# Custom
# Isosurfacing
number_slider = Slider(1, range=0..10)
# Mesh Loft &
# Mesh Pipe
crv = Curve([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])
# ___  _  _  ____   __   _  _   __  ____   __  ____  __  ____
#  / __)/ )( \(  _ \ /  \ ( \/ ) /  \(    \ /  \(  _ \(  )/ ___)
# ( (__ ) __ ( )   /(  O )/ \/ \(  O )) D ((  O ))   / )( \___ \
#  \___)\_)(_/(__\_) \__/ \_)(_/ \__/(____/ \__/(__\_)(__)(____/
# 
# Version 0.0.9.0 Example Files.
# 
# Copyright Cameron Newnham 2015-2016
# Isosurfacing
number_slider_2 = Slider(2, range=0..10)
crv_2 = Curve([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])
# Points: Input is points only. More points means slower computation.
crv_3 = Curve([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])
divlength = DivideLength(Curve=crv_2, Length=number_slider)  # -> flatten(Points), Tangents, Parameters
divlength_2 = DivideLength(Curve=crv_3, Length=number_slider_2)  # -> flatten(Points), Tangents, Parameters
cp = ControlPoints(Curve=crv)  # -> Points, Weights, Knots
avr = Average(Input=divlength.Points)
project = Project(Geometry=cp.Points, Plane=PlaneXY(0, 0, 0))  # -> Geometry, Transform
# Charge Values: Allow variations in thickness by setting custom densities.
dist = Distance(PointA=divlength.Points, PointB=avr)
pline = PolyLine(Vertices=project.Geometry, Closed=False)
graft = GraftTree(Tree=crv, IncludeEmptyLists=True, IncludeNullItems=True)
# Mesh Pipe: A simple and fast mesh piping operation, similar to !_ApplyCurvePiping in Rhino.
mpipe = MeshPipe(Polylines=crv, NumberOfSides=Slider(10, range=1..10), Radius=Slider(0.2, range=0..1), Cap=False)
# Voxel Size: The target mesh face size. Smaller values mean higher resolution but computes exponentially slower.
# Effective Range: This is the maximum search range (hence thickness) for each point. Usually approximately double the voxel size. Larger values are slower to compute.
voxelsample = SampleVoxels(
    Points=divlength_2.Points,
    VoxelSize=Slider(2, range=0..10),
    EffectiveRange=Slider(5, range=0..10),
    DensitySampling=False,
    LinearSampling=True)  # -> Box, VoxelData
bnd = Bounds(Numbers=dist)
remap = RemapNumbers(Value=dist, Source=bnd, Target="3 To .1")  # -> Mapped, Clipped
# Mesh Loft: A very fast method for lofting polylines together where a welded mesh is the desired outcome.
mloft = MeshLoft(Polylines=[graft, pline], Cap=False)
move = Move(Geometry=mpipe, Motion=Vector(0, 0, 10))  # -> Geometry, Transform
mcol = MeshColours(Mesh=move.Geometry, Colours=RGB(0, 72, 255))
# Sample Value: The isovalue. Changes the thickness of the produced mesh.
isosurface = BuildIsoSurface(Box=voxelsample.Box, VoxelData=voxelsample.VoxelData, SampleValue=Slider(0.25, range=0..1))
lng = ListLength(List=flatten(mloft))
range = Range(Domain=Domain(0, 1), Steps=expr("x-1", lng))
box = Box({Plane=PlaneXY(177.6508713, -3.077653829, 0), X=Domain(0, 84.22887296), Y=Domain(0, 77.97038086), Z=Domain(0, 71.45540012)})
jitter = Jitter(List=flatten(mloft), Jitter=1, Seed=2)  # -> graft(Values), Indices
gradient = Gradient(
    LowerLimit=0,
    UpperLimit=1,
    Parameter=range,
    stops=[0: RGB(243, 57, 0), 0.1: RGB(236, 27, 60), 0.2: RGB(210, 0, 118), 0.3: RGB(103, 0, 120), 0.4: RGB(39, 72, 161), 0.5: RGB(1, 192, 229), 0.6: RGB(18, 178, 90), 0.7: RGB(79, 186, 8), 0.8: RGB(220, 237, 32), 0.9: RGB(247, 159, 20), 1: RGB(243, 57, 0)])
# Custom Component: Overrides the automatic computation of the bounding box and x,y,z resolutions.
voxelsample_c = SampleVoxelsCustom(
    Points=divlength.Points,
    Charges=remap.Mapped,
    Box=box,
    XResolution=Slider(50, range=0..100),
    YResolution=Slider(50, range=0..100),
    ZResolution=Slider(60, range=0..100),
    EffectiveRange=Slider(5, range=0..10),
    DensitySampling=False,
    LinearSampling=True)  # -> Box, VoxelData
# Smoothing: A very fast but basic implementation of Laplacian smoothing. Step size is a direct smoothing multiplier, and iterations is the number of times to repeat the operation.
smooth = QuickSmooth(Mesh=isosurface, Step=0.5, Iterations=Slider(13, range=0..100))
mcol_2 = MeshColours(Mesh=jitter.Values, Colours=graft(gradient))
# Close Voxel Grid: "Caps" the edges of an open isosurface before construction.
close = CloseVoxelData(Data=voxelsample_c.VoxelData)
mjoin = MeshJoin(Meshes=mcol_2)
isosurface_2 = BuildIsoSurface(Box=voxelsample_c.Box, VoxelData=close, SampleValue=Slider(0.67, range=0..1))
# Draft Angle Display: A quick way of visualizing form.
draft = DraftAngle(Mesh=smooth, MinimumDraft=Slider(-45, range=-90..90), MaximumDraft=Slider(45, range=-90..90))
smooth_2 = QuickSmooth(Mesh=isosurface_2, Step=0.5, Iterations=Slider(5, range=0..100))
curvature = CurvatureApproximation(Mesh=smooth_2)  # -> MinimumRadius, MaximumRadius, MeanCurvature, GaussianCurvature, MinimumCurvatureDirection, MaximumCurvatureDirection
# Curvature Display: A very crude but fast curvature approximation based only on adjacent vertices.
gradient_2 = Gradient(
    LowerLimit=0,
    UpperLimit=1,
    Parameter=curvature.MinimumRadius,
    stops=[0: RGB(0, 128, 0), 0.11: RGB(255, 255, 0), 0.305: RGB(255, 0, 0)])
mcol_3 = MeshColours(Mesh=smooth_2, Colours=gradient_2)
mblur = BlurMesh(Mesh=mcol_3, Iterations=1)
