# Grasshopper definition Examples_02.gh (Grasshopper 0.9.76)
# plug-ins: Chromodoris, Kangaroo Components

# ___  _  _  ____   __   _  _   __  ____   __  ____  __  ____
#  / __)/ )( \(  _ \ /  \ ( \/ ) /  \(    \ /  \(  _ \(  )/ ___)
# ( (__ ) __ ( )   /(  O )/ \/ \(  O )) D ((  O ))   / )( \___ \
#  \___)\_)(_/(__\_) \__/ \_)(_/ \__/(____/ \__/(__\_)(__)(____/
# 
# Version 0.0.9.0 Benchmark.
# 
# Copyright Cameron Newnham 2015-2016
box = Box({Plane=PlaneXY(0, 0, 0), X=Domain(0, 100), Y=Domain(0, 100), Z=Domain(0, 50)})
pop3d = Populate3D(Region=box, Count=Slider(500, range=0..1000), Seed=1)
prox = Proximity3D(Points=pop3d, Group=5)  # -> Links, Topology
dupln = RemoveDuplicateLines(Lines=flatten(prox.Links), Tolerance=0.01)
line = Line(dupln)
number_slider = Slider(1, range=0..10)
divlength = DivideLength(Curve=line, Length=Slider(1, range=0..10))  # -> flatten(Points), Tangents, Parameters
voxelsample = SampleVoxels(
    Points=divlength.Points,
    VoxelSize=Slider(0.5, range=0..1),
    EffectiveRange=Slider(3, range=0..10),
    DensitySampling=False,
    LinearSampling=True)  # -> Box, VoxelData
isosurface = BuildIsoSurface(Box=voxelsample.Box, VoxelData=voxelsample.VoxelData, SampleValue=Slider(1.024, range=0..10))
mesh = Mesh(isosurface)
smooth = QuickSmooth(Mesh=mesh, Step=0.75, Iterations=Slider(11, range=0..100))
mesh_2 = Mesh(smooth)
